# Grasshopper definition RozvanyCompute.gh (Grasshopper 1.0.7)
# plug-ins: Kangaroo2 Components

Z = UnitZ(Factor=1)

grid_size = Slider(0.6, range=0..1.2)
X = Slider(14, range=5..20)
Y = Slider(12, range=5..20)
genes = GenePool(Decimals=0, Maximum=1, Minimum=-1, Value=[1, 1, 1, 0])

spacing = GetNumber(grid_size, AtLeast=1, AtMost=2147483647, Maximum=1.797693135e+308, Minimum=-1.797693135e+308)
expression = Expression(x=spacing, Expression="x/sin(pi/2)")
leftfix = GetInteger(Slider(0, range=-1..1), AtLeast=1, AtMost=2147483647, Maximum=2147483647, Minimum=-2147483648)
x_dim = GetNumber(X, AtLeast=1, AtMost=2147483647, Maximum=1.797693135e+308, Minimum=-1.797693135e+308)
y_dim = GetNumber(Y, AtLeast=1, AtMost=2147483647, Maximum=1.797693135e+308, Minimum=-1.797693135e+308)
bottomfix = GetInteger(Slider(0, range=-1..1), AtLeast=1, AtMost=2147483647, Maximum=2147483647, Minimum=-2147483648)
rightfix = GetInteger(Slider(0, range=-1..1), AtLeast=1, AtMost=2147483647, Maximum=2147483647, Minimum=-2147483648)
topfix = GetInteger(Slider(0, range=-1..1), AtLeast=1, AtMost=2147483647, Maximum=2147483647, Minimum=-2147483648)
merge = Merge(Data1=bottomfix, Data2=rightfix, Data3=topfix, Data4=leftfix)

# ----
# Boundary Shape
X_2 = UnitX(Factor=x_dim)
Y_2 = UnitY(Factor=y_dim)
vec = VectorXYZ(XComponent=X_2, YComponent=Y_2, ZComponent=0)  # -> Vector, Length
int = Integer(merge)
pt = ConstructPoint(XCoordinate=0, YCoordinate=0, ZCoordinate=0)
move = Move(Geometry=pt, Motion=X_2)  # -> Geometry, Transform
move_2 = Move(Geometry=pt, Motion=Y_2)  # -> Geometry, Transform
move_3 = Move(Geometry=pt, Motion=vec.Vector)  # -> Geometry, Transform
pline = PolyLine(Vertices=[pt, move.Geometry, move_3.Geometry, move_2.Geometry], Closed=invert(False))

mindex = MemberIndex(Set=int, Member=1)  # -> Index, Count
int_2 = Integer(Slider(-1, range=-2..1))
int_3 = Integer(merge)
mindex_2 = MemberIndex(Set=int_3, Member=int_2)  # -> Index, Count
int_4 = Integer(merge)
int_5 = Integer(merge)
int_6 = Integer(merge)
area = Area(Geometry=pline)  # -> Area, Centroid
replace = ReplaceItems(List=merge, Item=-5, Indices=mindex_2.Index, Wrap=False)
neg = Negative(Value=area.Centroid)
shift = ShiftList(List=replace, Shift=1, Wrap=True)
move_4 = Move(Geometry=pline, Motion=neg)  # -> Geometry, Transform
explode = Explode(Curve=move_4.Geometry, Recursive=True)  # -> Segments, Vertices
item = ListItem(List=explode.Segments, Index=mindex.Index, Wrap=True)
expression_2 = Expression(x=replace, y=shift, z=replace, Expression="if((x=-5) and (y=-5), z-5, z)")
cull_i = CullIndex(List=explode.Vertices, Indices=-1, Wrap=True)
shift_2 = ShiftList(List=explode.Segments, Shift=1, Wrap=True)
vec_2 = Vector(explode.Segments)
vec_3 = Vector(shift_2)
angle = Angle(VectorA=vec_2, VectorB=vec_3)  # -> Angle, Reflex
expression_3 = Expression(Expression="atan(sqrt(2))")
expression_4 = Expression(Expression="pi/2 - atan(sqrt(2))")
shift_3 = ShiftList(List=expression_2, Shift=1, Wrap=True)
Z_2 = UnitZ(Factor=1)
Z_3 = UnitZ(Factor=1)
subtraction = Subtraction(A=expression_2, B=shift_3)
Z_4 = UnitZ(Factor=1)
vrot = Rotate(Vector=vec_2, Axis=Z_2, Angle=expr("x/2", angle.Angle))
shift_4 = ShiftList(List=subtraction, Shift=-1, Wrap=True)
vrot_2 = Rotate(Vector=vec_2, Axis=Z_3, Angle=expression_4)
vrot_3 = Rotate(Vector=vec_2, Axis=Z_4, Angle=expression_3)
expression_5 = Expression(x=shift_4, Expression="if(x=0, 0, if(x=1, 1, if(x=-1, 2, 3)))")
expression_6 = Expression(x=merge, Expression="if(x=-1, 1, 0)")
p_n_c = PickNChoose(Pattern=expression_5, Stream0=vrot, Stream1=vrot_2, Stream2=vrot_3)
line = LineSDL(Start=cull_i, Direction=p_n_c, Length=1)
ma = MassAddition(Input=expression_6)  # -> Result, PartialResults
expression_7 = Expression(x=ma.Result, Expression="if(x>0, 1, 0)")
shift_5 = ShiftList(List=line, Shift=1, Wrap=True)
llx = LineLine(Line1=line, Line2=shift_5)  # -> ParamA, ParamB, PointA, PointB
ln = Line(StartPoint=llx.PointA, EndPoint=cull_i)
shift_6 = ShiftList(List=ln, Shift=1, Wrap=True)

# ----
# Junction Center
ccx = CurveCurve(CurveA=ln, CurveB=shift_6)  # -> flatten(Points), ParamsA, ParamsB

ccx_2 = CurveCurve(CurveA=ln, CurveB=shift_6)  # -> Points, ParamsA, ParamsB
duppt = RemoveDuplicatePts(Points=ccx.Points, Tolerance=0.01)
unflatten = UnflattenTree(Tree=duppt, Guide=ccx_2.Points)
prune = PruneTree(Tree=unflatten, Minimum=1, Maximum=0)
filter = StreamFilter(Gate=expression_7, Stream0=prune, Stream1=llx.PointA)
null = NullItem(Item=filter)  # -> NullFlags, InvalidFlags, Description
not = GateNot(A=null.NullFlags)
cull = CullPattern(List=filter, CullPattern=not)
crv_cp = CurveClosestPoint(Point=cull, Curve=explode.Segments)  # -> Point, Parameter, Distance
ln_2 = Line(StartPoint=cull, EndPoint=crv_cp.Point)
prune_2 = PruneTree(Tree=ln_2, Minimum=1, Maximum=0)
vec_4 = Vector(prune_2)
null_2 = NullItem(Item=vec_4)  # -> NullFlags, InvalidFlags, Description
not_2 = GateNot(A=null_2.NullFlags)
cull_2 = CullPattern(List=vec_4, CullPattern=not_2)
multiplication = Multiplication(A=cull_2, B="0.5")
len = Length(Curve=prune_2)
null_3 = NullItem(Item=len)  # -> NullFlags, InvalidFlags, Description
not_3 = GateNot(A=null_3.NullFlags)
move_5 = Move(Geometry=cull, Motion=cull_2)  # -> Geometry, Transform
move_6 = Move(Geometry=cull, Motion=multiplication)  # -> Geometry, Transform
cull_3 = CullPattern(List=len, CullPattern=not_3)  # -> flatten(List)
unflatten_2 = UnflattenTree(Tree=cull_3, Guide=prune_2)

# ----
# Line Lengths
expression_8 = Expression(x=int, y=unflatten_2, Expression="if(x=0,y*sqrt(2), if(x=1, y, z)) ")

cset = CreateSet(List=expression_8)  # -> Set, Map
mindex_3 = MemberIndex(Set=expression_8, Member=cset.Set)  # -> Index, Count
lng = ListLength(List=mindex_3.Index)

# ----
# Associated support indexes
expression_9 = Expression(x=lng, y=mindex_3.Index, Expression="if(x≥3, y, \"error\")")
prune_3 = PruneTree(Tree=expression_9, Minimum=2, Maximum=0)  # -> simplify(Tree)

item_2 = ListItem(List=explode.Segments, Index=mindex_2.Index, Wrap=True)
tstat = TreeStatistics(Tree=prune_3)  # -> Paths, Length, Count
shift_7 = ShiftList(List=tstat.Paths, Shift=1, Wrap=True)
geo = Geometry(explode.Segments)
shift_8 = ShiftList(List=prune_3, Shift=1, Wrap=True)
branch = TreeBranch(Tree=prune_3, Path=flatten(tstat.Paths), MaintainPaths=True)
branch_2 = TreeBranch(Tree=prune_3, Path=shift_7, MaintainPaths=False)
intersection = SetIntersection(SetA=branch, SetB=branch_2)
item_3 = ListItem(List=geo, Index=prune_3, Wrap=True)
item_4 = ListItem(List=geo, Index=shift_8, Wrap=True)
llx_2 = LineLine(Line1=item_3, Line2=item_4)  # -> ParamA, ParamB, PointA, PointB
c_script = CSharpScript()  # -> out, flatten(A); inputs cu: Curve; disabled
# ---------- c_script: C# usings ----------
using System.IO;
using System.Linq;
using System.Data;
using System.Drawing;
using System.Reflection;
using System.Windows.Forms;
using System.Xml;
using System.Xml.Linq;
using System.Runtime.InteropServices;

using Rhino.DocObjects;
using Rhino.Collections;
using GH_IO;
using GH_IO.Serialization;
# ---------- c_script: C# ----------
    //var oa = new Rhino.DocObjects.ObjectAttributes();
    //oa.SetUserString("test", "value");
    var attributes = new ObjectAttributes();
    attributes.ObjectColor = Color.CadetBlue;
    attributes.ColorSource = ObjectColorSource.ColorFromObject;
    Rhino.DocObjects.Tables.ObjectTable ot = Rhino.RhinoDoc.ActiveDoc.Objects;
    ot.Add(cu, attributes);
    A = cu;

    //doc.Objects.AddCurve(cu, attributes);
    //doc.Views.Redraw();
# ---------- end c_script ----------
c_script_2 = CSharpScript()  # -> out, flatten(A); inputs cu: Curve; disabled
# ---------- c_script_2: C# ----------
    var attributes = new ObjectAttributes();
    attributes.ObjectColor = Color.CadetBlue;
    attributes.ColorSource = ObjectColorSource.ColorFromObject;
    doc.Objects.AddCurve(cu, attributes);
    doc.Views.Redraw();
# ---------- end c_script_2 ----------
c_script_3 = CSharpScript()  # -> out, flatten(A); inputs cu: Curve, co: Color; disabled
# ---------- c_script_3: C# ----------
    if (cu == null) return;
    if (co.A == 0) return;

    _curves.Add(cu);
    _colors.Add((co));
# ---------- c_script_3: C# additional code ----------
  private readonly List<Curve> _curves = new List<Curve>();
  private readonly List<System.Drawing.Color> _colors = new List<System.Drawing.Color>();
  public List<Line> A;
  private BoundingBox _box;

  /// <summary>
  /// This method will be called once every solution, before any calls to RunScript.
  /// </summary>
  public override void BeforeRunScript()
  {
    _box = BoundingBox.Empty;
    _curves.Clear();
    _colors.Clear();
  }

  public override BoundingBox ClippingBox
  {
    get { return _box; }
  }

  public override void DrawViewportWires(IGH_PreviewArgs args)
  {
    for (int i = 0; i < _curves.Count; i++)
      args.Display.DrawCurve(_curves[i], _colors[i]);
  }
# ---------- end c_script_3 ----------
bang = ExplodeTree(Data=intersection)  # -> Branch0, Branch1
c_script_4 = CSharpScript(geom=explode.Segments, key="myName", value="boundary")  # -> out, A; inputs geom: list of Curve, key: String, value: String
# ---------- c_script_4: C# ----------
    ObjectAttributes attr = new ObjectAttributes();
    attr.Name = _key;
    Rhino.DocObjects.Tables.ObjectTable ot = Rhino.RhinoDoc.ActiveDoc.Objects;

    //delete existing objects
    Rhino.DocObjects.ObjectEnumeratorSettings settings = new Rhino.DocObjects.ObjectEnumeratorSettings();
    settings.NameFilter = _key;
    System.Collections.Generic.List<Guid> ids = new System.Collections.Generic.List<Guid>();
    foreach (Rhino.DocObjects.RhinoObject rhObj in doc.Objects.GetObjectList(settings)){
      ids.Add(rhObj.Id);
    }

    if (ids.Count == 0){
      Print("No objects with the name " + _value);
    }else{
      //delete previous object table by ID in Rhino
      foreach (Guid id in ids) {
        ot.Delete(id, true);
      }
    }


    for (int i = 0; i < geom.Count; i++){
      attr.SetUserString(_key, _value);
      ot.AddCurve(geom[i], attr);
    }

    A = geom;
# ---------- end c_script_4 ----------
item_5 = ListItem(List=geo, Index=bang.Branch0, Wrap=True)
Z_5 = UnitZ(Factor=1)
vec_5 = Vector(item_5)

# ---- group: Rh_OUT:boundary
crv = Curve(c_script_4.A)

# ----
mindex_4 = MemberIndex(Set=int, Member=-1)  # -> Index, Count
Z_6 = UnitZ(Factor=1)
vrot_4 = Rotate(Vector=vec_5, Axis=Z_5, Angle=-1.570796327)
subtraction_2 = Subtraction(A=mindex_4.Index, B=1)
addition = Addition(A=mindex_4.Index, B=1)
item_6 = ListItem(List=geo, Index=[subtraction_2, addition], Wrap=True)
vec_6 = Vector(item_6)
vrot_5 = Rotate(Vector=vec_6, Axis=Z_6, Angle=1.570796327)
null_4 = NullItem(Item=llx_2.PointA)  # -> NullFlags, InvalidFlags, Description
shift_9 = ShiftList(List=prune_3, Shift=1, Wrap=True)
null_5 = NullItem(Item=llx_2.PointA)  # -> NullFlags, InvalidFlags, Description
not_4 = GateNot(A=null_4.NullFlags)
not_5 = GateNot(A=null_5.NullFlags)
cull_4 = CullPattern(List=shift_9, CullPattern=not_4)
cull_5 = CullPattern(List=prune_3, CullPattern=not_5)
item_7 = ListItem(List=geo, Index=cull_4, Wrap=True)
item_8 = ListItem(List=geo, Index=cull_5, Wrap=True)
Z_7 = UnitZ(Factor=1)
vec_7 = Vector(item_7)
Z_8 = UnitZ(Factor=1)
vec_8 = Vector(item_8)
vrot_6 = Rotate(Vector=vec_7, Axis=Z_7, Angle=-1.570796327)  # -> graft(Vector)
vrot_7 = Rotate(Vector=vec_8, Axis=Z_8, Angle=-1.570796327)  # -> graft(Vector)

panel = Panel("""0.25
0.75""")
mindex_5 = MemberIndex(Set=int, Member=-1)  # -> Index, Count
item_9 = ListItem(List=mindex_5.Index, Index=-1, Wrap=True)
item_10 = ListItem(List=cull_i, Index=item_9, Wrap=True)
item_11 = ListItem(List=explode.Segments, Index=item_9, Wrap=True)
mindex_6 = MemberIndex(Set=int, Member=-1)  # -> Index, Count
Z_9 = UnitZ(Factor=1)
panel_2 = Panel("""pi/8
pi/8+pi/4""")
split = SplitList(List=mindex_5.Index, Index=1)  # -> ListA, ListB
vec_9 = Vector(item_11)
item_12 = ListItem(List=mindex_5.Index, Index=-1, Wrap=True)
addition_2 = Addition(A=mindex_6.Index, B=1)
item_13 = ListItem(List=explode.Segments, Index=addition_2, Wrap=True)
len_2 = Length(Curve=item_13)
multiplication_2 = Multiplication(A=len_2, B=panel)
eval = EvaluateCurve(Curve=graft(item_13), Parameter=multiplication_2)  # -> Point, Tangent, Angle
split_2 = SplitList(List=mindex_6.Index, Index=1)  # -> ListA, ListB
vrot_8 = Rotate(Vector=vec_9, Axis=Z_9, Angle=panel_2)
subtraction_3 = Subtraction(A=split.ListA, B=split.ListB)
addition_3 = Addition(A=item_12, B=2)
addition_4 = Addition(A=item_12, B=1)
item_14 = ListItem(List=int, Index=addition_2, Wrap=True)
subtraction_4 = Subtraction(A=split_2.ListA, B=split_2.ListB)
bang_2 = ExplodeTree(Data=eval.Point)  # -> Branch0, Branch1
line_2 = LineSDL(Start=item_10, Direction=vrot_8, Length=1)
item_15 = ListItem(List=explode.Segments, Index=[addition_4, addition_3], Wrap=True)
item_16 = ListItem(List=int, Index=[addition_4, addition_3], Wrap=True)
abs = Absolute(Value=subtraction_3)
ma_2 = MassAddition(Input=item_14)  # -> Result, PartialResults
abs_2 = Absolute(Value=subtraction_4)
rev = ReverseList(List=bang_2.Branch1)
llx_3 = LineLine(Line1=line_2, Line2=item_15)  # -> ParamA, ParamB, PointA, PointB
ma_3 = MassAddition(Input=item_16)  # -> Result, PartialResults
addition_5 = Addition(A=abs_2, B=ma_2.Result)
addition_6 = Addition(A=abs, B=ma_3.Result)
ln_3 = Line(StartPoint=bang_2.Branch0, EndPoint=rev)
ln_4 = Line(StartPoint=item_10, EndPoint=llx_3.PointA)
expression_10 = Expression(
    x=addition_5,
    y=addition_6,
    z=mindex_6.Count,
    u=mindex_5.Count,
    v=split.ListA,
    w=split.ListB,
    Expression="if((x=4) and (z=2), 0, if((y=3) and (u=2), 1, if((v=0) and (w=3), 1, 2)))")

item_17 = ListItem(List=explode.Segments, Index=reverse(mindex_5.Index), Wrap=True)
vec_10 = Vector(item_17)
end = EndPoints(Curve=ln_4)  # -> Start, graft(End)
vrot_9 = Rotate(Vector=graft(vec_10), Axis=Z, Angle=-1.570796327)
bang_3 = ExplodeTree(Data=end.End)  # -> _0000, _0001
ln_5 = Line(StartPoint=bang_3._0000, EndPoint=bang_3._0001)
vec_11 = Vector(ln_5)
item_18 = ListItem(List=ln_4, Index=1, Wrap=True)
item_19 = ListItem(List=ln_4, Index=0, Wrap=True)
ccx_3 = CurveCurve(CurveA=graft(ln_4), CurveB=reverse(item))  # -> Points, ParamsA, flatten(ParamsB)
shatter = Shatter(Curve=reverse(item), Parameters=graft(ccx_3.ParamsB))
bang_4 = ExplodeTree(Data=shatter)  # -> Branch0, Branch1, Branch2
end_2 = EndPoints(Curve=bang_4.Branch0)  # -> Start, End
end_3 = EndPoints(Curve=bang_4.Branch1)  # -> Start, End
merge_2 = Merge(Data1=end_2.Start, Data2=end_2.End)
intersection_2 = SetIntersection(SetA=[end_2.Start, end_2.End], SetB=[end_3.Start, end_3.End])
merge_3 = Merge(Data1=end_3.Start, Data2=end_3.End)
mindex_7 = MemberIndex(Set=merge_2, Member=intersection_2)  # -> Index, Count
mindex_8 = MemberIndex(Set=merge_3, Member=intersection_2)  # -> Index, Count
expression_11 = Expression(x=mindex_7.Index, Expression="if((x=1) or(x=3),1,if((x=0) or (x=2), 0, 2))")
expression_12 = Expression(x=mindex_8.Index, Expression="if((x=1) or(x=3),1,if((x=0) or (x=2), 0, 2))")
divdist = DivideDistance(Curve=item_19, Distance=spacing)  # -> Points, Tangents, Parameters
line_3 = LineSDL(Start=divdist.Points, Direction=graft(vec_11), Length=1)
llx_4 = LineLine(Line1=line_3, Line2=graft(item_18))  # -> ParamA, ParamB, PointA, PointB
merge_4 = Merge(Data1=divdist.Points, Data2=llx_4.PointA)
line_4 = LineSDL(Start=merge_4, Direction=graft(vrot_9), Length=1)
llx_5 = LineLine(Line1=line_4, Line2=graft(item_17))  # -> ParamA, ParamB, PointA, PointB
ln_6 = Line(StartPoint=llx_5.PointA, EndPoint=merge_4)
ln_7 = Line(StartPoint=divdist.Points, EndPoint=llx_4.PointA)
item_20 = ListItem(List=bang_4.Branch0, Index=expression_11, Wrap=True)
item_21 = ListItem(List=bang_4.Branch1, Index=expression_12, Wrap=True)
divdist_2 = DivideDistance(Curve=item_20, Distance=expression)  # -> Points, Tangents, Parameters
line_5 = LineSDL(Start=divdist_2.Points, Direction=graft(vec_11), Length=1)
llx_6 = LineLine(Line1=item_21, Line2=line_5)  # -> ParamA, ParamB, PointA, PointB
ln_8 = Line(StartPoint=divdist_2.Points, EndPoint=llx_6.PointA)

filter_2 = StreamFilter(Gate=expression_10, Stream0=ln_3, Stream1=[ln_4, ln_7, ln_6, ln_8, ln_5])

preview = CustomPreview(Geometry=filter_2, Material=ColourSwatch(SwatchColor=RGB(0, 0, 0)))

# ----
# Boundary Fixities
number_slider = Slider(0, range=0..1)

int_7 = Integer(number_slider)
int_8 = Integer(Slider(1, range=0..1))
int_9 = Integer(Slider(-1, range=-2..1))

mindex_9 = MemberIndex(Set=int_4, Member=int_7)  # -> Index, Count
mindex_10 = MemberIndex(Set=int_5, Member=int_8)  # -> Index, Count
mindex_11 = MemberIndex(Set=int_6, Member=int_9)  # -> Index, Count
item_22 = ListItem(List=explode.Segments, Index=mindex_9.Index, Wrap=True)
item_23 = ListItem(List=explode.Segments, Index=mindex_11.Index, Wrap=True)
item_24 = ListItem(List=explode.Segments, Index=mindex_10.Index, Wrap=True)
preview_2 = CustomPreview(Geometry=item_22, Material=ColourSwatch(SwatchColor=RGB(0, 0, 0)))
preview_3 = CustomPreview(Geometry=item_24, Material=ColourSwatch(SwatchColor=RGB(0, 217, 250)))
preview_4 = CustomPreview(Geometry=item_23, Material=ColourSwatch(SwatchColor=RGB(21, 255, 0)))

# ----
# Junction Vertices
expression_13 = Expression(x=int, y=move_5.Geometry, z=move_6.Geometry, u=move_6.Geometry, Expression="if(x=0, y, if(x=1, z, u))")

null_6 = NullItem(Item=expression_13)  # -> NullFlags, InvalidFlags, Description
not_6 = GateNot(A=null_6.NullFlags)
cull_6 = CullPattern(List=expression_13, CullPattern=not_6)
prune_4 = PruneTree(Tree=cull_6, Minimum=1, Maximum=0)  # -> flatten(Tree)
unflatten_3 = UnflattenTree(Tree=prune_4, Guide=expression_13)

item_25 = ListItem(List=unflatten_3, Index=prune_3, Wrap=True)

shift_10 = ShiftList(List=item_25, Shift=1, Wrap=True)

# ----
# Junction Center Lines
ln_9 = Line(StartPoint=item_25, EndPoint=shift_10)

preview_5 = CustomPreview(Geometry=ln_9, Material=ColourSwatch(SwatchColor=RGB(255, 15, 243)))
crv_cp_2 = CurveClosestPoint(Point=item_25, Curve=item_2)  # -> Point, Parameter, Distance
ln_10 = Line(StartPoint=item_25, EndPoint=crv_cp_2.Point)
sort = SortList(Keys=ln_10)  # -> Keys, ValuesA
item_26 = ListItem(List=unflatten_3, Index=shift_8, Wrap=True)
item_27 = ListItem(List=unflatten_3, Index=prune_3, Wrap=True)
item_28 = ListItem(List=sort.Keys, Index=-1, Wrap=True)
len_3 = Length(Curve=ln_10)
item_29 = ListItem(List=unflatten_3, Index=intersection, Wrap=True)
mindex_12 = MemberIndex(Set=len_3, Member=item_28)  # -> Index, Count
bang_5 = ExplodeTree(Data=item_29)  # -> _000000001, _000000003
ln_11 = Line(StartPoint=llx_2.PointA, EndPoint=item_27)  # -> flatten(Line)
ln_12 = Line(StartPoint=llx_2.PointA, EndPoint=item_26)  # -> flatten(Line)
null_7 = NullItem(Item=ln_11)  # -> NullFlags, InvalidFlags, Description
null_8 = NullItem(Item=ln_12)  # -> NullFlags, InvalidFlags, Description

# ----
# Internal branches
ln_13 = Line(StartPoint=bang_5._000000001, EndPoint=bang_5._000000003)

not_7 = GateNot(A=null_7.NullFlags)
not_8 = GateNot(A=null_8.NullFlags)
preview_6 = CustomPreview(Geometry=ln_13, Material=ColourSwatch(SwatchColor=RGB(4, 0, 255)))

# ----
# edge branches
cull_i_2 = CullIndex(List=ln_10, Indices=mindex_12.Index, Wrap=True)  # -> flatten(List)
cull_7 = CullPattern(List=ln_12, CullPattern=not_8)
cull_8 = CullPattern(List=ln_11, CullPattern=not_7)

divdist_3 = DivideDistance(Curve=ln_13, Distance=spacing)  # -> Points, Tangents, Parameters
clean = CleanTree(RemoveNulls=True, RemoveInvalid=True, RemoveEmpty=False, Tree=[cull_8, cull_7, cull_i_2])
bang_6 = ExplodeTree(Data=divdist_3.Points)  # -> _0000000010, _0000000011
preview_7 = CustomPreview(Geometry=[cull_i_2, cull_7, cull_8], Material=ColourSwatch(SwatchColor=RGB(0, 0, 0)))
end_4 = EndPoints(Curve=cull_8)  # -> Start, End
end_5 = EndPoints(Curve=cull_7)  # -> Start, End
item_30 = ListItem(List=cull_i_2, Index=0, Wrap=True)
item_31 = ListItem(List=cull_i_2, Index=-1, Wrap=True)
c_script_5 = CSharpScript(geom=clean, key="myName", value="edge")  # -> out, A; inputs geom: list of Curve, key: String, value: String; same code as c_script_4
c_script_6 = CSharpScript(geom=ln_13, key="myName", value="internal")  # -> out, A; inputs geom: list of Curve, key: String, value: String; same code as c_script_4
c_script_7 = CSharpScript(geom=ln_9, key="myName", value="junction")  # -> out, A; inputs geom: list of Curve, key: String, value: String; same code as c_script_4
ln_14 = Line(StartPoint=end_4.End, EndPoint=end_4.Start)
ln_15 = Line(StartPoint=end_5.End, EndPoint=end_5.Start)
divdist_4 = DivideDistance(Curve=[item_30, item_31], Distance=spacing)  # -> Points, Tangents, Parameters
cull_i_3 = CullIndex(List=bang_6._0000000011, Indices=0, Wrap=True)
cull_i_4 = CullIndex(List=bang_6._0000000010, Indices=0, Wrap=True)
end_6 = EndPoints(Curve=ln_15)  # -> Start, End
end_7 = EndPoints(Curve=ln_14)  # -> Start, End
bang_7 = ExplodeTree(Data=divdist_4.Points)  # -> Branch0, Branch1

# ---- group: RH_OUT:edge
crv_2 = Curve(c_script_5.A)

# ---- group: RH_OUT:junction
# These dont work
crv_3 = Curve(c_script_7.A)

# ---- group: RH_OUT:internal
crv_4 = Curve(c_script_6.A)

# ----
ln_16 = Line(StartPoint=cull_i_4, EndPoint=cull_i_3)
vec2pt = Vector2Pt(PointA=end_7.Start, PointB=end_6.Start, Unitize=False)  # -> Vector, Length
ln_17 = Line(StartPoint=bang_7.Branch0, EndPoint=bang_7.Branch1)
line_6 = LineSDL(Start=divdist_3.Points, Direction=graft(vrot_4), Length=1)
preview_8 = CustomPreview(Geometry=ln_16, Material=ColourSwatch(SwatchColor=RGB(0, 0, 0)))
preview_9 = CustomPreview(Geometry=ln_17, Material=ColourSwatch(SwatchColor=RGB(0, 0, 0)))
line_7 = LineSDL(Start=divdist_4.Points, Direction=graft(vrot_5), Length=1)
llx_7 = LineLine(Line1=line_6, Line2=graft(item_5))  # -> ParamA, ParamB, PointA, PointB
divdist_5 = DivideDistance(Curve=ln_14, Distance=spacing)  # -> Points, Tangents, Parameters
line_8 = LineSDL(Start=divdist_5.Points, Direction=graft(vec2pt.Vector), Length=1)
llx_8 = LineLine(Line1=line_8, Line2=graft(ln_15))  # -> ParamA, ParamB, PointA, PointB
ln_18 = Line(StartPoint=divdist_5.Points, EndPoint=llx_8.PointA)
llx_9 = LineLine(Line1=line_7, Line2=graft(item_6))  # -> ParamA, ParamB, PointA, PointB
ln_19 = Line(StartPoint=llx_7.PointA, EndPoint=divdist_3.Points)
cull_i_5 = CullIndex(List=ln_18, Indices=0, Wrap=True)
preview_10 = CustomPreview(Geometry=ln_19, Material=ColourSwatch(SwatchColor=RGB(0, 0, 0)))
ln_20 = Line(StartPoint=llx_9.PointA, EndPoint=divdist_4.Points)
preview_11 = CustomPreview(Geometry=cull_i_5, Material=ColourSwatch(SwatchColor=RGB(0, 0, 0)))
preview_12 = CustomPreview(Geometry=ln_20, Material=ColourSwatch(SwatchColor=RGB(0, 0, 0)))
line_9 = LineSDL(Start=llx_8.PointA, Direction=vrot_6, Length=1)
line_10 = LineSDL(Start=divdist_5.Points, Direction=vrot_7, Length=1)
llx_10 = LineLine(Line1=line_9, Line2=graft(item_7))  # -> ParamA, ParamB, PointA, PointB
llx_11 = LineLine(Line1=line_10, Line2=graft(item_8))  # -> ParamA, ParamB, PointA, PointB
ln_21 = Line(StartPoint=llx_8.PointA, EndPoint=llx_10.PointA)
ln_22 = Line(StartPoint=divdist_5.Points, EndPoint=llx_11.PointA)
crv_5 = Curve(flatten([ln_22, ln_21, ln_20, ln_17, ln_19, ln_16, filter_2, cull_i_5]))
clean_2 = CleanTree(RemoveNulls=True, RemoveInvalid=True, RemoveEmpty=False, Tree=crv_5)
c_script_8 = CSharpScript(geom=clean_2, key="myName", value="intLines")  # -> out, A; inputs geom: list of Curve, key: String, value: String; same code as c_script_4

# ---- group: RH_OUT:intlines
crv_6 = Curve(c_script_8.A)

# ---- group: RH_OUT
# This works
crv_7 = Curve(simplify([clean, clean_2, explode.Segments, ln_13, ln_9]))

# ----
preview_13 = CustomPreview(Geometry=ln_22, Material=ColourSwatch(SwatchColor=RGB(0, 0, 0)))
preview_14 = CustomPreview(Geometry=ln_21, Material=ColourSwatch(SwatchColor=RGB(0, 0, 0)))
